# Grasshopper definition Growing_line_with_friction Angle Collider.gh (Grasshopper 1.0.7)
# plug-ins: Kangaroo2 Components, Vipers, Heteroptera

segments_length = Slider(2, range=0..11)

# ---- group: Starting curves
curve = Curve([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])
curve_2 = Curve([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])

# ----
len = Length(Curve=curve)
division = Division(A=len, B=segments_length)
divide = DivideCurve(Curve=curve, Count=division, Kinks=False)  # -> simplify(Points), Tangents, Parameters
lng = ListLength(List=divide.Points)
randvect = RandomVectors(Number=lng, Length=Slider(0.21, range=0..1), seed=92877, isflat=True)
number_slider = Slider(360, range=0..500)
move = Move(Geometry=divide.Points, Motion=randvect)  # -> Geometry, Transform
panel = Panel(randvect)
multiplication = Multiplication(A=number_slider, B=0.6486)
dam = DataDam(BufferDelay=10000000, BufferMode=0)
pline = PolyLine(Vertices=move.Geometry, Closed=invert(False))  # -> flatten(Polyline)
plane_surface = PlaneSurface(Plane=PlaneXY(0, 0, 0), XSize=number_slider, YSize=multiplication)
explode = Explode(Curve=pline, Recursive=True)  # -> Segments, Vertices
mesh_surface = MeshSurface(Surface=plane_surface, UCount=5, VCount=5, Overhang=True, Equalize=False)
number_slider_2 = Slider(1.772, range=0.3..16)
pt = Point(move.Geometry)
shift = ShiftList(List=explode.Segments, Shift=1, Wrap=True)
list = ValueList({"One": 1, "Two": 2, "Three": 2² - 1, "Four": Sqrt(16)}, selected="Three")
cluster = Cluster(pt=pt)  # -> pt_4, int_3, int_4
asd = Asd(line=explode.Segments)  # -> line_4, int_4, int_3
multiplication_2 = Multiplication(A=number_slider_2, B=list)

# ---- group: Starting mesh
mesh = Mesh(mesh_surface)

# ----
show = Show(G=pline)
onmesh = OnMesh(Points=move.Geometry, Mesh=mesh, Strength="2000")
length_line = LengthLine(Line=flatten(explode.Segments), Length=Slider(9.36, range=0..100), Strength="10")
angle = Angle(LineA=explode.Segments, LineB=shift, RestAngle="0", Strength=Slider(1500, range=0..10000))
collider = Collider(Objects=cluster.pt_4, Radii=multiplication_2, IgnoreA=cluster.int_3, IgnoreB=cluster.int_4, Strength="1000")
collider_2 = Collider(Objects=asd.line_4, Radii=number_slider_2, IgnoreA=asd.int_4, IgnoreB=asd.int_3, Strength="1000")

entwine = Entwine(
    Branch00=show,
    Branch01=onmesh,
    Branch02=length_line,
    Branch03=angle,
    Branch04=collider,
    Branch05=collider_2,
    FlattenInputs=True)
reset = Button()
on = BooleanToggle(False)
solver = Solver(GoalObjects=entwine, Reset=reset, Threshold=1e-15, Tolerance=0.01, On=on)  # -> I, V, O
bang = ExplodeTree(Data=solver.O)  # -> Branch0, Branch1, Branch2, Branch3, Branch4, Branch5
crv = Curve(bang.Branch0)
cls = Closed()  # -> Closed, Periodic
explode_2 = Explode(Recursive=True)  # -> Segments, Vertices
intcrv = Interpolate(Vertices=explode_2.Vertices, Degree=3, Periodic=graft(cls.Closed), KnotStyle=1)  # -> Curve, Length, Domain
randomgeometrycolor = RandomColor(Property=crv, Colour=RGB(255, 255, 0), Seed=0)

# ==== cluster Asd
line = ClusterInput()
line_2 = Line(line)
line_3 = Line(flatten(line_2))
index = Index(L=line_3)
lng = ListLength(List=line_2)  # -> flatten(Length)
line_4 = ClusterOutput(line_3)
partition = PartitionList(List=index, Size=lng)
shift = ShiftList(List=partition, Shift=1, Wrap=True)
int = Integer(flatten(partition))
int_2 = Integer(flatten(shift))
int_3 = ClusterOutput(int_2)
int_4 = ClusterOutput(int)

# ==== cluster Cluster
pt = ClusterInput()
pt_2 = Point(pt)
pt_3 = Point(flatten(pt_2))
pt_4 = ClusterOutput(pt_3)
lng = ListLength(List=pt_2)  # -> flatten(Length)
index = Index(L=pt_3)
partition = PartitionList(List=index, Size=lng)
shift = ShiftList(List=partition, Shift=1, Wrap=True)
int = Integer(flatten(partition))
int_2 = Integer(flatten(shift))
int_3 = ClusterOutput(int)
int_4 = ClusterOutput(int_2)

# ==== cluster Index: Quan Li
L = ClusterInput()
lng = ListLength(List=L)
series = Series(Start=0, Step=1, Count=lng)
S = ClusterOutput(series)
